test file "MassSpringDamper"

suite "StepResponse"

  case "VaryingDampingCoefficient" [simulation]
    tags: nightly, unit
    model mass_spring_damper
    parameter set "UnderDampedParameterSet": m = 10, k = 5, b = 0.01*(4*m*k)  % base workspace
    parameter set "CriticallyDampedParameterSet" (off): m = 10, k = 5, b = sqrt(4*m*k)  % base workspace
    parameter set "OverDampedParameterSet" (off): m = 10, k = 5, b = 4*m*k  % base workspace
    parameter set "UndampedParameterSet" (off): b = 0, k = 5, m = 10  % base workspace
    post-load callback:
      % Some initial values
      m = 10;
      k = 5;
      b = 0.01*(4*m*k);
    custom criteria:
      % Validation for CriticallyDamped iteration
      if ~strcmp(sltest_iterationName, 'CriticallyDamped')
          return
      end

      % Access position
      logsout = sltest_simout.get('logsout');
      values  = logsout.getElement(1).Values.Data;
      time    = logsout.getElement(1).Values.Time;

      % Calculate step response
      s = stepinfo(values, time);

      % Validate that system's settling time is under 5 seconds
      test.verifyLessThan(s.SettlingTime, 5, 'Settling time expected to be less than 5 seconds.');
    iterations:
      UnderDamped: ParameterSet "UnderDampedParameterSet"
      CriticallyDamped: ParameterSet "CriticallyDampedParameterSet"
      OverDamped: ParameterSet "OverDampedParameterSet"
      Undamped: ParameterSet "UndampedParameterSet"